# Grasshopper definition FullGyro.gh (Grasshopper 1.0.7)

hole_depth = Slider(5, range=0..10)
hole_radius = Slider(1.75, range=0..5)

outer_radius = Slider(39, range=0..50)
ring_width = Slider(5, range=0..10)
ring_offset = Slider(1, range=0..10)
num_rings = Slider(5, range=0..5)
height = Slider(5, range=0..5)

subtraction = Subtraction(A=num_rings, B=1)
division = Division(A=subtraction, B=2)
yz_plane = YZPlane(Origin=Point(0, 0, 0))
addition = Addition(A=ring_width, B=ring_offset)
subtraction_2 = Subtraction(A=outer_radius, B=addition)
round = Round(Number=division)  # -> Nearest, Floor, Ceiling
subtraction_3 = Subtraction(A=outer_radius, B=ring_width)
circle = Circle(Plane=yz_plane, Radius=hole_radius)
multiplication = Multiplication(B=2)
addition_2 = Addition(A=subtraction_2, B=0.5)
multiplication_2 = Multiplication(A=addition, B=-1)
xz_plane = XZPlane(Origin=Point(0, 0, 0))
series = Series(Start=0, Step=multiplication, Count=round.Floor)
series_2 = Series(Start=addition_2, Step=multiplication, Count=round.Ceiling)
circle_2 = Circle(Plane=xz_plane, Radius=hole_radius)
unit_y = UnitY(Factor=series_2)
unit_x = UnitX(Factor=series)
multiplication_3 = Multiplication(A=unit_y, B=-1)
series_3 = Series(Start=subtraction_3, Step=multiplication_2, Count=num_rings)
series_4 = Series(Start=outer_radius, Step=multiplication_2, Count=num_rings)
move = Move(Geometry=circle_2, Motion=unit_y)  # -> Geometry, Transform
move_2 = Move(Geometry=circle, Motion=unit_x)  # -> Geometry, Transform
move_3 = Move(Geometry=circle_2, Motion=multiplication_3)  # -> Geometry, Transform
multiplication_4 = Multiplication(A=hole_depth, B=-1)
unit_y_2 = UnitY(Factor=multiplication_4)
unit_y_3 = UnitY(Factor=hole_depth)
merge = Merge(Data1=series_4, Data2=series_3)
unit_x_2 = UnitX(Factor=hole_depth)
circle_3 = Circle(Plane=PlaneXY(0, 0, 0), Radius=merge)
multiplication_5 = Multiplication(A=unit_x_2, B=-1)
unit_z = UnitZ(Factor=height)
boundary_surfaces = BoundarySurfaces(Edges=circle_3)
extrude = Extrude(Base=boundary_surfaces, Direction=unit_z)
extrude_2 = Extrude(Base=move_2.Geometry, Direction=multiplication_5)
extrude_3 = Extrude(Base=move.Geometry, Direction=unit_y_2)
extrude_4 = Extrude(Base=move_3.Geometry, Direction=unit_y_3)
cap_holes = CapHoles(Brep=extrude_3)
