# Grasshopper definition first-clip.gh (Grasshopper 1.0.7)

clip_radius = Slider(10, range=0..10)
slide_width = Slider(2, range=0..10)
slot_depth = Slider(10, range=0..10)
slot_distance = Slider(1.874, range=0..10)
num_slots = Slider(4, range=0..10)
division = Division(A=slide_width, B=-2)
circle = Circle(Plane=PlaneXY(0, 0, 0), Radius=clip_radius)
rectangle = Rectangle(Plane=PlaneXY(0, 0, 0), XSize=slide_width, YSize=slot_depth, Radius=0)  # -> Rectangle, Length
vector_xyz = VectorXYZ(XComponent=division, YComponent=slot_distance, ZComponent=0)  # -> Vector, Length
move = Move(Geometry=rectangle.Rectangle, Motion=vector_xyz.Vector)  # -> Geometry, Transform
polar_array = PolarArray(Geometry=move.Geometry, Plane=PlaneXY(0, 0, 0), Count=num_slots, Angle=6.283185307)  # -> Geometry, Transform
group = Group(Objects=[polar_array.Geometry, circle])
