# Grasshopper definition lissajous-knot-generator.gh (Grasshopper 1.0.7)

scalefactor = Slider(14, range=1..20)
thickness = Slider(4, range=1..10)
scalefactor_2 = Slider(50, range=1..50)
thickness_2 = Slider(1, range=1..10)
n_x = Slider(2, range=1..20)
phi_z = Slider(2.9, range=0..6.2)
n_y = Slider(9, range=1..20)
n_z = Slider(7, range=1..20)
phi_x = Slider(0, range=0..6.2)
ghpython_script = GhPythonScript(scaleFactor=scalefactor, thickness=thickness)  # -> out, a
#   port numPoints: The number of circles. (integer)
# ---------- ghpython_script: Python ----------
import math
import rhinoscriptsyntax as rs

# deal with inputs
if numPoints is None:
    numPoints = 361   
if scaleFactor is None:
    y = 1    
if thickness is None:
    thickness = 1
    
points = []

for i in range(int(numPoints)):
    t = math.radians(i)
    x = (math.sin(t) + 2*math.sin(2*t))
    y = math.cos(t) - 2*math.cos(2*t)
    z = -1*math.sin(3*t)
    pt = (scaleFactor* x,scaleFactor*y,scaleFactor*z)
    id = rs.AddPoint(pt)
    points.append(id)
    
knot = rs.AddInterpCurve(points)

if knot:
    domain = rs.CurveDomain(knot)
    piped_knot = rs.AddPipe(knot,0,thickness)

a = knot
# ---------- end ghpython_script ----------
ghpython_script_2 = GhPythonScript(scaleFactor=scalefactor_2, thickness=thickness_2, n_x=n_x, n_y=n_y, n_z=n_z, phi_x=phi_x, phi_y=phi_z)  # -> out, a
# ---------- ghpython_script_2: Python ----------
__author__ = "blairsubbaraman"

import math
import rhinoscriptsyntax as rs

# deal with inputs
if numPoints is None:
    numPoints = 360  
if scaleFactor is None:
    scaleFactor = 1
if thickness is None:
    thickness = 1
if n_x is None:
    n_x = 3
if n_y is None:
    n_y = 2
if n_z is None:
    n_z = 7
if phi_x is None:
    phi_x = 0.7
if phi_y is None:
    phi_y = 0.2
    
points = []


for i in range(int(numPoints)):
    t = math.radians(i)
    x = math.cos(n_x*t + phi_x)
    y = math.cos(n_y*t + phi_y)
    z = math.cos(n_z*t)
    pt = (scaleFactor* x,scaleFactor*y,scaleFactor*z)
    id = rs.AddPoint(pt)
    points.append(id)

points.append(points[-1])
knot = rs.AddInterpCurve(points)
closed_knot = rs.CloseCurve(knot, 5)

if closed_knot:
    domain = rs.CurveDomain(knot)
    piped_knot = rs.AddPipe(closed_knot,0,thickness)

a = piped_knot
# ---------- end ghpython_script_2 ----------
panel = Panel(ghpython_script.out)
panel_2 = Panel(ghpython_script_2.out)
panel_3 = Panel(ghpython_script_2.a)
panel_4 = Panel(ghpython_script.a)
